vi "Index.gviweb"   [LabVIEW NXG 5.0.0]
panel controls:
  "Pi (cmH2O)": f64 = 15
  "EDIT MODE": enum{"V A/C", "P A/C", "PSV", "VSIMV", "PSIMV"} = "P A/C"
  "PEEP (cmH2O)": f64 = 5
  "Rate": f64 = 13
  "Start": bool
  "Rise Time": f64 = 2
  "Insp. Time": f64 = 1.5
  "I Sense": f64 = 3
  "Vt Target": f64 = 400
  "SilenceAL": bool
  "PauseAL": bool
  "Freeze Graphs": bool
  "Edit and Apply": bool
  "URL": string = "http://127.0.0.1:8001/WebService1/"
  "Rate_2": f64 = 13
  "PIP (cmH2O)": f64 = 5
  "PIP (cmH2O)_3": f64 = 5
  "PIP (cmH2O)_4": f64
  "PIP (cmH2O)_6": f64 = 5
  "PIP (cmH2O)_7": f64 = 5
  "PIP (cmH2O)_9": f64 = 5
  "PIP (cmH2O)_10": f64 = 5
  "PIP (cmH2O)_12": f64
  "Alarm": bool
  "Waveform": bool
  "Alarm Log": bool
  "Back to Ventilation_3": bool
  "Back to Ventilation_2": bool
  "Apnea Alarm": enum{"YES", "NO"} = "YES"
  "Pediatric Circuite": enum{"YES", "NO"} = "YES"
  "Back to Ventilation_4": bool
  "Back to Alarm": bool
  "Report": bool
  "Pi (cmH2O)_2": f64 = 15
  "EDIT MODE_2": enum{"V A/C", "P A/C", "PSV", "VSIMV", "PSIMV"} = "P A/C"
  "PEEP (cmH2O)_2": f64 = 5
  "Rate_5": f64 = 13
  "Start_2": bool
  "Rise Time_2": f64 = 2
  "Insp. Time_2": f64 = 1.5
  "I Sense_2": f64 = 3
  "Vt Target_2": f64 = 400
  "Change Mode_2": bool
  "Rate_6": f64 = 13
  "Alarm_3": bool
  "Waveform_2": bool
  "Preference_2": bool
  "Setup_2": bool
  "PIP (cmH2O)_13": f64 = 5
  "PIP (cmH2O)_14": f64 = 5
  "PIP (cmH2O)_15": f64 = 5
  "PIP (cmH2O)_16": f64
  "PIP (cmH2O)_17": f64 = 5
  "PIP (cmH2O)_18": f64 = 5
  "PIP (cmH2O)_19": f64 = 5
  "PIP (cmH2O)_20": f64
  "PIP (cmH2O)_21": f64 = 5
  "PIP (cmH2O)_22": f64 = 5
  "PIP (cmH2O)_23": f64 = 5
  "PIP (cmH2O)_24": f64
  "Ventilation_7": bool
  "Alarm Log_2": bool
  "PressureChart_2": f64[]
  "FlowChart_2": f64[]
  "VolumeChart_2": f64[]
  "Freeze Graphs_2": bool
  "Ventilation_8": bool
  "Date_2": string = "27-08-2020"
  "Time_2": string = "11:50:55"
  "Machine Hour_2": string
  "Patient Hour_2": string = "1:30:88"
  "Pressure Settings_2": enum{"RELATIVE", "ABSOLUTE"} = "RELATIVE"
  "Reset Patient Hour_2": bool
  "Ventilation_9": bool
  "Maintanance_2": bool
  "Calibration_2": bool
  "Ventilation Report_2": i32 = -1
  "Pediatric Circuite_2": enum{"YES", "NO"} = "YES"
  "Apnea Alarm_2": enum{"YES", "NO"} = "YES"
  "Ventilation_10": bool
  "Patient Pressure_2": cluster{"Slope(M)": f64, "Intercept(c)": f64} = {"Slope(M)"=5, "Intercept(c)"=5}
  "Insp Valve Pressure_2": cluster{"Slope(M)": f64, "Intercept(c)": f64} = {"Slope(M)"=5, "Intercept(c)"=5}
  "Insp Flow_2": cluster{"Slope(M)": f64, "Intercept(c)": f64} = {"Slope(M)"=5, "Intercept(c)"=5}
  "Exhalation flow_2": cluster{"Slope(M)": f64, "Intercept(c)": f64} = {"Slope(M)"=5, "Intercept(c)"=5}
  "Fio2_2": cluster{"Slope(M)": f64, "Intercept(c)": f64} = {"Slope(M)"=5, "Intercept(c)"=5}
  "Ventilation_11": bool
  "Fault Check list_2": i32 = -1
  "Software Version No_2": string = "3455X776"
  "Serial No_2": string = "3465546"
  "Turbine Speed Test_2": string
  "Rate_7": f64 = 13
  "UP_2": bool
  "Down_2": bool
  "Max_2": bool
  "Altitude Settinds_2": enum{"YES", "NO"} = "YES"
  "Rate_8": f64 = 13
  "Ventilation_12": bool
  "Alarm Log List_2": i32 = -1
  "Alarm_4": bool
  "Export report": bool
panel indicators:
  "Tab": i32
  "cmH2O": f64
  "VtI (mL)": f64
  "VtE (mL)": f64
  "M Vol (L)": f64
  "Rate (bpm)": f64
  "I": f64
  "FiO2 (%)": f64
  "E": f64
  "Active Mode": string
  "Pressure": string
  "Last Alarm": string
  "Status": string
  "PressureChart": f64[]
  "FlowChart": f64[]
  "value": cluster{"Acknowledged": bool}
  "body": string
  "PIP (cmH2O)_2": f64
  "PIP (cmH2O)_5": f64
  "PIP (cmH2O)_8": f64
  "PIP (cmH2O)_11": f64
  "Alarm Log List": i32
  "Ti(s)": f64
  "Te(s)": f64
  "PEEP(CMofH2O)": f64
  "PIP(CMofH2O)": f64
  "Ventilation time": string
  "Date": string
  "Ventilation Report": string
  "Vte": string
  "Vti": string
  "Spondanous Breath": string
  "Paw": string
  "Apnea Ti": string
  "Rate_3": string
  "Machine Hour": string
  "Patient Hour": string
types:
  T1 = cluster{"M Vol (L)": f64, "VtI (mL)": f64, "Rate (bpm)": f64, "E": f64, "cmH2O": f64, "VtE (mL)": f64, "Pressure": f64[], "Flow": f64[], "Volume": f64[]}
  T2 = cluster{"Rate": f64, "Insp. Time": f64, "Pi (cmH2O)": f64, "PEEP (cmH2O)": f64, "Vt Target": f64}
uses:
  NI::HTTP::GET.gvi
  NI::HTTP::POST Buffer.gvi
  WebApp::Keypad.gvi
diagram:
  Build Array(reference to "Alarm", reference to "Waveform", reference to "Report", reference to "Edit and Apply", reference to "EDIT MODE") -> w1
  Build Array(reference to "Vt Target", reference to "Pi (cmH2O)", reference to "Insp. Time", reference to "Rise Time", reference to "Rate", reference to "I Sense", reference to "PEEP (cmH2O)", reference to "Rate_2") -> w2
  Build Array(reference to "Start", reference to "Edit and Apply") -> w3
  for {
    w4 = each element of w3
    Property Node(instance in=w4, "Value"=FALSE) -> (error out=w6)
    append w6 to w5
  }
  Property Node(instance in=reference to "Tab", "Value"=0) -> (instance out=w7)
  s1 = w7  # shift register
  s2 = uninitialised  # shift register
  while (after w5) (after 0) {
    w8 = $URL
    event (timeout = 200) {
      on "Timeout" {
        disable {
          frame Enabled {
            w11 = default
          }
          frame Disabled {
            Property Node(instance in=cluster{"HMI": u16} {all zero or empty}, "HMI"=$"EDIT MODE") -> (instance out=w12)
            Flatten To Json(anything=w12) -> (JSON string=w13, error out=w11)
          }
        }
        Concatenate Strings(w8, "General") -> w14
        call "GET.gvi"(timeout=100, url=w14, error in=w11) -> (body=w15, error out=w16)
        Unflatten From Json(JSON string=w15, error in (no error)=w16, type and defaults=T1 {all zero or empty}) -> (value=w17)
        Property Node(instance in=w17) -> ("M Vol (L)"=w18, "VtI (mL)"=w19, "Rate (bpm)"=w20, "E"=w21, "cmH2O"=w22, "VtE (mL)"=w23, "Pressure"=w24, "Flow"=w25, "Volume"=w26)
        $"M Vol (L)" <- w18
        $"VtI (mL)" <- w19
        $"Rate (bpm)" <- w20
        $E <- w21
        $cmH2O <- w22
        case ($"Freeze Graphs") {
          frame True { }
          frame False {
            $PressureChart <- w24
            $FlowChart <- w25
          }
        }
        $"VtE (mL)" <- w23
        w9 = s1
        w10 = s2
      }
      on "Insp. Time" Value changed; "PEEP (cmH2O)" Value changed; "Pi (cmH2O)" Value changed; "Rate" Value changed; "Vt Target" Value changed {
        Concatenate Strings(w8, "UpdatePara") -> w27
        Property Node(instance in=T2 {all zero or empty}, "Rate"=$Rate, "Insp. Time"=$"Insp. Time", "Pi (cmH2O)"=$"Pi (cmH2O)", "PEEP (cmH2O)"=$"PEEP (cmH2O)", "Vt Target"=$"Vt Target") -> (instance out=w28)
        Flatten To Json(anything=w28) -> (JSON string=w29, error out=w30)
        call "POST Buffer.gvi"(url=w27, buffer=w29, error in=w30, timeout=100) -> (body=w31, error out=w32)
        $body <- w31
        Unflatten From Json(JSON string=w31, error in (no error)=w32, type and defaults=cluster{"Acknowledged": bool} {all zero or empty}) -> (value=w33)
        $value <- w33
        w9 = s1
        w10 = default
      }
      on "Start" Value changed {
        Event Data() -> ("Control Reference"=w34, "New Value"=w10)
        case (w10) {
          frame False {
            for {
              w36 = each element of w2
              Property Node(instance in=w36, "Disabled"=FALSE)
            }
            Build Array("Active ventilation") -> w37
            Property Node(instance in=w34, "Text"=w37)
            Property Node(instance in=reference to "EDIT MODE", "Disabled"=FALSE)
            for {
              w38 = each element of w1
              w39 = each element of [FALSE, TRUE, FALSE, TRUE]
              Property Node(instance in=w38, "Disabled"=w39)
            }
            w35 = "-"
          }
          frame True {
            for {
              w40 = each element of w2
              Property Node(instance in=w40, "Disabled"=TRUE)
            }
            Property Node(instance in=reference to "EDIT MODE") -> ("Value"=w41)
            Format Into String(w41) -> w35
            Property Node(instance in=reference to "EDIT MODE", "Disabled"=TRUE)
            Build Array("Go to Stand by") -> w42
            Property Node(instance in=w34, "Text"=w42)
            for {
              w43 = each element of w1
              w44 = each element of [FALSE, FALSE, FALSE, FALSE]
              Property Node(instance in=w43, "Disabled"=w44)
            }
          }
        }
        $"Active Mode" <- w35
        w9 = s1
      }
      on "Alarm" Value changed; "Alarm Log" Value changed; "Back to Alarm" Value changed; "Back to Ventilation_2" Value changed; "Back to Ventilation_3" Value changed; "Back to Ventilation_4" Value changed; "Report" Value changed; "Waveform" Value changed {
        Event Data() -> ("Control Reference"=w45)
        Property Node(instance in=w45) -> ("Text"=w46)
        Array Index(array=w46) -> (out0[0]=w47)
        case (w47) {
          frame "Report" {
            w48 = 3
          }
          frame "Waveform" {
            w48 = 2
          }
          frame "Alarm" {
            w48 = 1
          }
          frame "Back to Ventilation_2", "Back to Ventilation_3", "Back to Ventilation_4", Default {
            w48 = 0
          }
          frame "Alarm Log" {
            w48 = 4
          }
          frame "Back to Alarm" {
            w48 = 1
          }
        }
        Property Node(instance in=s1, "Value"=w48) -> (instance out=w9)
        w10 = default
      }
      on "EDIT MODE" Value changed {
        case (s2) {
          frame True {
            Property Node(instance in=reference to "Edit and Apply", "Disabled"=FALSE)
          }
          frame False {
            Property Node(instance in=reference to "Edit and Apply", "Disabled"=TRUE)
          }
        }
        Event Data() -> ("New Value"=w49)
        case (w49) {
          frame "V A/C", Default {
            w51 = ["Vt", "PIP", "Insp Time", "Ramp Pattern", "Rate", "I Sense", "NA", "NA"]
            w50 = w51
          }
          frame "P A/C" {
            w52 = ["Pi (cmH2O)", "PEEP", "Rise time", "Insp time", "Rate", "I Sense", "NA", "NA"]
            w50 = w52
          }
          frame "PSV" {
            w53 = ["P support", "PEEP", "Rise time", "Min I time", "Max I time", "I Sense", "E Sense", "Apnea time"]
            w50 = w53
          }
          frame "VSIMV" {
            w54 = ["Vt", "PEEP", "Rise time", "P support", "Rate", "I Sense", "E Sense", "Insp time"]
            w50 = w54
          }
          frame "PSIMV" {
            w55 = ["Pi", "PEEP", "Rise time", "P support", "Rate", "I Sense", "E Sense", "Insp time"]
            w50 = w55
          }
        }
        for {
          w56 = each element of w50
          w57 = each element of w2
          Property Node(instance in=w57) -> ("Label"=w58)
          Property Node(instance in=w58, "Text"=w56)
        }
        w9 = s1
        w10 = s2
      }
      on "Edit and Apply" Value changed {
        Event Data() -> ("Control Reference"=w59, "New Value"=w60)
        case (w60) {
          frame True {
            Build Array("Apply") -> w61
            Property Node(instance in=w59, "Text"=w61)
            for {
              w62 = each element of w2
              Property Node(instance in=w62, "Disabled"=FALSE)
            }
            Property Node(instance in=reference to "EDIT MODE", "Disabled"=FALSE)
          }
          frame False {
            Build Array("Edit") -> w63
            Property Node(instance in=w59, "Text"=w63)
            for {
              w64 = each element of w2
              Property Node(instance in=w64, "Disabled"=TRUE)
            }
            Property Node(instance in=reference to "EDIT MODE", "Disabled"=TRUE)
            Property Node(instance in=reference to "EDIT MODE") -> ("Value"=w65)
            Format Into String(w65) -> w66
            Property Node(instance in=reference to "Active Mode", "Value"=w66)
          }
        }
        w9 = s1
        w10 = s2
      }
    }
    next s1 = w9
    next s2 = w10
    stop if FALSE
  }
  for {
    w67 = each element of w1
    w68 = each element of [FALSE, TRUE, FALSE, TRUE, FALSE]
    Property Node(instance in=w67, "Disabled"=w68)
  }
  $Tab <- 0
  call "Keypad.gvi"()
